# Grasshopper definition Interference.gh (Grasshopper 0.9.70)
# Copyright: Copyright <c> RMA 2013

R = Region({Plane=PlaneXY(0, 0, 0), Size=Domain2(u=0..30, v=0..30)})
mplane = MeshPlane(Boundary=R, WidthCount=50, HeightCount=50)  # -> Mesh, Area
demesh = DeconstructMesh(Mesh=mplane.Mesh)  # -> Vertices, Faces, Colours, Normals
pop2d = Populate2D(Region=R, Count=2, Seed=Slider(0, range=0..9))
dist = Distance(PointA=pop2d, PointB=graft(demesh.Vertices))
graph = GraphMapper(
    dist,
    x0=0,
    x1=20,
    y0=0,
    y1=5,
    container_name="Sinc",
    Equation_X0=0,
    Equation_X1=0.09946655482,
    Equation_Y0=0.7932432294,
    Equation_Y1=0.1575676203)
ma = MassAddition(Input=graph)  # -> flatten(Result), PartialResults
Z = UnitZ(Factor=ma.Result)
move = Move(Geometry=demesh.Vertices, Motion=Z)  # -> Geometry, Transform
conmesh = ConstructMesh(Vertices=move.Geometry, Faces=demesh.Faces)
