# Grasshopper definition NearestNeighbour.gh (Grasshopper 0.9.70)
# Copyright: Copyright <c> RMA 2013

R = Region({Plane=PlaneXY(-54.1114643, -0.5194904759, 0), Size=Domain2(u=0..53.71633177, v=0..30.56728297)})
mplane = MeshPlane(Boundary=R, WidthCount=50, HeightCount=50)  # -> Mesh, Area
number_slider = Slider(9, range=0..10)
demesh = DeconstructMesh(Mesh=mplane.Mesh)  # -> Vertices, Faces, Colours, Normals
pop2d = Populate2D(
    Region=R,
    Count=Slider(7, range=0..10),
    Seed=Slider(2, range=0..10),
    Points=[<geometry referenced from the Rhino model> x5])
split = SplitList(List=pop2d, Index=Slider(6, range=0..10))  # -> ListA, ListB
cp = ClosestPoint(Point=demesh.Vertices, Cloud=split.ListB)  # -> ClosestPoint, CPIndex, Distance
cp_2 = ClosestPoint(Point=demesh.Vertices, Cloud=split.ListA)  # -> ClosestPoint, CPIndex, Distance
dist = Distance(PointA=cp.ClosestPoint, PointB=demesh.Vertices)
graph = GraphMapper(
    dist,
    x0=0,
    x1=20,
    y0=0,
    y1=8,
    container_name="Sinc",
    Equation_X0=0.05130108818,
    Equation_X1=0.1306818128,
    Equation_Y0=0.206802085,
    Equation_Y1=0.06289308518)
dist_2 = Distance(PointA=cp_2.ClosestPoint, PointB=demesh.Vertices)
graph_2 = GraphMapper(
    dist_2,
    x0=0,
    x1=20,
    y0=0,
    y1=11,
    container_name="Sinc",
    Equation_X0=0,
    Equation_X1=0.1448777318,
    Equation_Y0=0.5556522012,
    Equation_Y1=0.1057971492)
Z = UnitZ(Factor=graph)
multiplication = Multiplication(A=Z, B=Slider(6, range=0..10))
Z_2 = UnitZ(Factor=graph_2)  # -> graft(UnitVector)
neg = Negative(Value=multiplication)  # -> graft(Result)
panel = Panel(neg)
multiplication_2 = Multiplication(A=Z_2, B=Slider(2, range=0..10))
avr = Average(Input=[multiplication_2, neg])  # -> flatten(ArithmeticMean)
panel_2 = Panel(avr)
pdecon = Deconstruct(Point=avr)  # -> XComponent, YComponent, ZComponent
eval = Evaluate(F="if (x>3, 3, x)", x=pdecon.ZComponent)
pt = ConstructPoint(XCoordinate=pdecon.XComponent, YCoordinate=pdecon.YComponent, ZCoordinate=eval)
sort = SortList(Keys=eval)  # -> Keys, ValuesA
sort_2 = SortList(Keys=pdecon.ZComponent)  # -> Keys, ValuesA
rev = ReverseList(List=sort.Keys)
rev_2 = ReverseList(List=sort_2.Keys)
move = Move(Geometry=demesh.Vertices, Motion=pt)  # -> Geometry, Transform
conmesh = ConstructMesh(Vertices=move.Geometry, Faces=demesh.Faces)
panel_3 = Panel(rev)
mirror = Mirror(Plane=PlaneYZ(0, 0, 0))  # -> Geometry, Transform
panel_4 = Panel(rev_2)
