# Grasshopper definition interference.ghx (Grasshopper 0.9.70)

sqgrid = Square(Plane=PlaneXY(0, 0, 0), Size=0.6, ExtentX=Slider(70, range=0..100), ExtentY=Slider(40, range=0..100))  # -> Cells, Points
pt = Point(<point referenced from the Rhino model>)
pt_2 = Point(<point referenced from the Rhino model>)
pcomp = Deconstruct(Point=sqgrid.Points)  # -> XComponent, YComponent, ZComponent
pcomp_2 = Deconstruct(Point=pt)  # -> XComponent, YComponent, ZComponent
pcomp_3 = Deconstruct(Point=pt_2)  # -> XComponent, YComponent, ZComponent
f_x_y = F2(Function="sin((x^2+y^2)^.5)", X=pcomp.XComponent, Y=pcomp.YComponent)
exp = VariableExpression(
    x=pcomp.XComponent,
    y=pcomp.YComponent,
    a=pcomp_3.XComponent,
    b=pcomp_3.YComponent,
    Expression="sin(((x-a)^2+(y-b)^2)^.5)")
exp_2 = VariableExpression(
    x=pcomp.XComponent,
    y=pcomp.YComponent,
    a=pcomp_2.XComponent,
    b=pcomp_2.YComponent,
    Expression="sin(((x-a)^2+(y-b)^2)^.5)")
addition = Addition(A=exp, B=exp_2)
pt_3 = ConstructPoint(XCoordinate=pcomp.XComponent, YCoordinate=pcomp.YComponent, ZCoordinate=addition)
flatten = FlattenTree(Tree=pt_3, Path="{0}")
srfgrid = SurfaceFromPoints(Points=flatten, UCount=71, Interpolate=False)
